# Grasshopper definition 3dbarchart.gh (Grasshopper 1.0.7)
# plug-ins: LunchBox, Hops, Pufferfish

hops = Hops(
    CacheResultsInMemory=False,
    CacheSolveResults=False,
    RemoteDefinitionLocation="http://127.0.0.1:5000/imft",
    RemoteSolveVersion=(0, 1, 0),
    ShowInput_Enabled=False,
    ShowInput_Path=False,
    SynchronousSolve=True)  # -> Footprints, Injuries, StructuralSystem, DamageStateProbabilities, OccupancyType, BuildingID
partition_list = PartitionList(List=hops.Injuries, Size="5")
partition_list_2 = PartitionList(List=hops.DamageStateProbabilities, Size="4")
curve = Curve(hops.Footprints)
polygon_center = PolygonCenter(Polyline=curve)  # -> CenterV, CenterE, CenterA
average = Average(Input=polygon_center.CenterV)
scale = Scale(Geometry=curve, Center=average, Factor=Slider(100000, range=0..100000))  # -> Geometry, Transform
curve_2 = Curve(scale.Geometry)

# ---- group: reduction
list_length = ListLength(List=curve_2)
subtraction = Subtraction(A=Slider(1, range=0..1), B=Slider(0.05, range=0..1))
multiplication = Multiplication(A=list_length, B=subtraction)
round = Round(Number=multiplication)  # -> Nearest, Floor, Ceiling
random_reduce = RandomReduce(List=curve_2, Reduction=round.Nearest, Seed=1)

# ----
curve_3 = Curve(curve_2)
list_length_2 = ListLength(List=curve_3)
repeat_data = RepeatData(Data=list_length_2, Length=Slider(4, range=0..10))
construct_domain = ConstructDomain(DomainStart=Slider(0.5, range=0..100), DomainEnd=Slider(6, range=0..100))
panel = Panel("""0
1
2
3""")
random = Random(Range=construct_domain, Number=graft(repeat_data), Seed=graft(panel))
number_slider = Slider(10, range=0..10)
multiplication_2 = Multiplication(A=random, B=number_slider)
round_2 = Round(Number=multiplication_2)  # -> Nearest, Floor, Ceiling
division = Division(A=round_2.Nearest, B=number_slider)
panel_2 = Panel(partition_list)
flip_matrix = FlipMatrix(Data=division)  # -> simplify(Data)
division_2 = Division(A=partition_list, B=10)
panel_3 = Panel(flip_matrix)
evaluate = Evaluate(Expression="Format(\"{0:R}\", x)", x=hops.BuildingID)
text_join = TextJoin(Text=partition_list, Join=", ")
text_join_2 = TextJoin(Text=partition_list, Join=", ")
list_item = ListItem(List=division_2, Index=0, Wrap=True)  # -> Item, Item1, Item2, Item3, Item4
panel_4 = Panel(division_2)
addition = Addition(A=list_item.Item, B=list_item.Item1)
addition_2 = Addition(A=addition, B=list_item.Item2)
addition_3 = Addition(A=addition_2, B=list_item.Item3)
data = Data(division_2)
addition_4 = Addition(A=addition_3, B=list_item.Item3)
concatenate = Concatenate(
    H="Building ID: ",
    G=evaluate,
    Fragment_A="Injuries: ",
    Fragment_B=flatten(text_join),
    A="Structure type: ",
    B=hops.StructuralSystem,
    C="Damage state probabilities: ",
    D=flatten(text_join_2),
    E="Occupancy type: ",
    F=hops.OccupancyType)
polygon_center_2 = PolygonCenter(Polyline=curve_2)  # -> CenterV, CenterE, CenterA
merge = Merge(Data1=list_item.Item, Data2=addition, Data3=addition_2, Data4=addition_3, Data5=addition_4)
panel_5 = Panel(merge)
panel_6 = Panel(concatenate)
unit_z = UnitZ(Factor=1)
amplitude = Amplitude(Vector=unit_z, Amplitude=merge)
text_tag_3d = TextTag3D(Location=polygon_center_2.CenterV, Text=concatenate, Size=1, Justification=7)
move = Move(Geometry=graft(curve_3), Motion=amplitude)  # -> Geometry, Transform
cull_index = CullIndex(List=move.Geometry, Indices="-1", Wrap=True)
insert_items = InsertItems(List=graft(curve_3), Item=cull_index, Indices="1", Wrap=True)
panel_7 = Panel(data)
unit_z_2 = UnitZ(Factor=1)
amplitude_2 = Amplitude(Vector=unit_z_2, Amplitude=data)
null_placeholder = NullPlaceholder()
expression = Expression(x=amplitude_2, y=null_placeholder, Expression="if(x = {0, 0, 0}, y, x)")
panel_8 = Panel(expression)
extrude = Extrude(Base=insert_items, Direction=expression)
cap_holes = CapHoles(Brep=extrude)
null_item = NullItem(Item=extrude)  # -> NullFlags, InvalidFlags, Description
flip_matrix_2 = FlipMatrix(Data=cap_holes)
flip_matrix_3 = FlipMatrix(Data=null_item.NullFlags)
cull_pattern = CullPattern(List=flip_matrix_2, CullPattern=invert(flip_matrix_3))
panel_9 = Panel(null_item.NullFlags)
explode_tree = ExplodeTree(Data=cull_pattern)  # -> _0000, _0100, _0200, _0300, _0400
colour_picker = ColourPicker(PickedColour=RGB(42, 255, 0))
colour_picker_2 = ColourPicker(PickedColour=RGB(191, 255, 0))
colour_picker_3 = ColourPicker(PickedColour=RGB(255, 242, 0))
colour_picker_4 = ColourPicker(PickedColour=RGB(255, 110, 0))
colour_picker_5 = ColourPicker(PickedColour=RGB(255, 0, 0))
custom_preview = CustomPreview(Geometry=explode_tree._0000, Material=colour_picker)
custom_preview_2 = CustomPreview(Geometry=explode_tree._0100, Material=colour_picker_2)
custom_preview_3 = CustomPreview(Geometry=explode_tree._0200, Material=colour_picker_3)
custom_preview_4 = CustomPreview(Geometry=explode_tree._0300, Material=colour_picker_4)
custom_preview_5 = CustomPreview(Geometry=explode_tree._0400, Material=colour_picker_5)
boolean_toggle = BooleanToggle(False)
object_bake = ObjectBake(
    BakeToggle=boolean_toggle,
    GeometryObjects=explode_tree._0000,
    Layer="green",
    ObjectName="GH_Obj",
    ObjectColor=colour_picker,
    LayerColor="0, 127, 0")
object_bake_2 = ObjectBake(
    BakeToggle=boolean_toggle,
    GeometryObjects=explode_tree._0100,
    Layer="yellow",
    ObjectName="GH_Obj",
    ObjectColor=colour_picker_2,
    LayerColor="255, 255, 0")
object_bake_3 = ObjectBake(
    BakeToggle=boolean_toggle,
    GeometryObjects=explode_tree._0200,
    Layer="orange",
    ObjectName="GH_Obj",
    ObjectColor=colour_picker_3,
    LayerColor="255, 127, 0")
object_bake_4 = ObjectBake(
    BakeToggle=boolean_toggle,
    GeometryObjects=explode_tree._0300,
    Layer="red orange",
    ObjectName="GH_Obj",
    ObjectColor=colour_picker_4,
    LayerColor="255, 60, 0")
object_bake_5 = ObjectBake(
    BakeToggle=boolean_toggle,
    GeometryObjects=explode_tree._0400,
    Layer="red",
    ObjectName="GH_Obj",
    ObjectColor=colour_picker_5,
    LayerColor="255, 0, 0")
